# Dynamo graph Ceiling.dyn (Dynamo 2.5.0.7460)

select_model_element = DSModelElementSelection()  # 1 picked in the model
curve = CurveElement.Curve(curveElement=select_model_element)
byPatch = Surface.ByPatch(closedCurve=curve)
select_model_element_2 = DSModelElementSelection()  # 1 picked in the model
curve_2 = CurveElement.Curve(curveElement=select_model_element_2)
code_block = CodeBlock { [0,1/6,2/6,3/6,4/6,5/6,1]; }
pointAtParameter = Curve.PointAtParameter(curve=curve_2, param=code_block)
code_block_2 = CodeBlock { y0=143/12; y1=142/12; y2=141/12; y3=140/12; y4=139/12; y5=138/12; y6=137/12; }
code_block_3 = CodeBlock(a=pointAtParameter, y=code_block_2.y0)
# ---------- code_block_3.designscript (3 lines) ----------
//Control 0
c0=a[0];
control=Point.ByCoordinates(c0.X,c0.Y,c0.Z+y);
# ----------------------------------------
code_block_4 = CodeBlock(a=pointAtParameter, y=code_block_2.y1)
# ---------- code_block_4.designscript (3 lines) ----------
//Control 1
c1=a[1];
control=Point.ByCoordinates(c1.X,c1.Y,c1.Z+y);
# ----------------------------------------
code_block_5 = CodeBlock(a=pointAtParameter, y=code_block_2.y2)
# ---------- code_block_5.designscript (3 lines) ----------
//Control 2
c2=a[2];
control=Point.ByCoordinates(c2.X,c2.Y,c2.Z+y);
# ----------------------------------------
code_block_6 = CodeBlock(a=pointAtParameter, y=code_block_2.y3)
# ---------- code_block_6.designscript (3 lines) ----------
//Control 3
c3=a[3];
control=Point.ByCoordinates(c3.X,c3.Y,c3.Z+y);
# ----------------------------------------
code_block_7 = CodeBlock(a=pointAtParameter, y=code_block_2.y4)
# ---------- code_block_7.designscript (3 lines) ----------
//Control 4
c4=a[4];
control=Point.ByCoordinates(c4.X,c4.Y,c4.Z+y);
# ----------------------------------------
code_block_8 = CodeBlock(a=pointAtParameter, y=code_block_2.y5)
# ---------- code_block_8.designscript (3 lines) ----------
//Control 5
c5=a[5];
control=Point.ByCoordinates(c5.X,c5.Y,c5.Z+y);
# ----------------------------------------
code_block_9 = CodeBlock(a=pointAtParameter, y=code_block_2.y6)
# ---------- code_block_9.designscript (3 lines) ----------
//Control 6
c6=a[6];
control=Point.ByCoordinates(c6.X,c6.Y,c6.Z+y);
# ----------------------------------------
select_model_element_3 = DSModelElementSelection()  # 1 picked in the model
curve_3 = CurveElement.Curve(curveElement=select_model_element_3)
code_block_10 = CodeBlock { [0,1/6,2/6,3/6,4/6,5/6,1]; }
pointAtParameter_2 = Curve.PointAtParameter(curve=curve_3, param=code_block_10)
code_block_11 = CodeBlock(a=pointAtParameter_2, y=code_block_2.y6)  # same code as code_block_9
code_block_12 = CodeBlock(a=pointAtParameter_2, y=code_block_2.y5)  # same code as code_block_8
code_block_13 = CodeBlock(a=pointAtParameter_2, y=code_block_2.y4)  # same code as code_block_7
code_block_14 = CodeBlock(a=pointAtParameter_2, y=code_block_2.y3)  # same code as code_block_6
code_block_15 = CodeBlock(a=pointAtParameter_2, y=code_block_2.y2)  # same code as code_block_5
code_block_16 = CodeBlock(a=pointAtParameter_2, y=code_block_2.y1)  # same code as code_block_4
code_block_17 = CodeBlock(a=pointAtParameter_2, y=code_block_2.y0)  # same code as code_block_3
code_block_18 = CodeBlock(a=code_block_3.control, b=code_block_4.control, c=code_block_5.control, d=code_block_6.control, e=code_block_7.control, f=code_block_8.control, g=code_block_9.control, h=code_block_11.control, i=code_block_12.control, j=code_block_13.control, k=code_block_14.control, l=code_block_15.control, m=code_block_16.control, n=code_block_17.control) { [a,b,c,d,e,f,g,h,i,j,k,l,m,n]; }
byPoints = NurbsCurve.ByPoints(points=code_block_18)
select_model_element_4 = DSModelElementSelection()  # 1 picked in the model
curve_4 = CurveElement.Curve(curveElement=select_model_element_4)
code_block_19 = CodeBlock { [0,1/6,2/6,3/6,4/6,5/6,1]; }
pointAtParameter_3 = Curve.PointAtParameter(curve=curve_4, param=code_block_19)
code_block_20 = CodeBlock(a=pointAtParameter_3)
# ---------- code_block_20.designscript (3 lines) ----------
//Control 6
c=a[];
control=Point.ByCoordinates(c.X,c.Y,c.Z+(143/12));
# ----------------------------------------
byPoints_2 = NurbsCurve.ByPoints(points=code_block_20.control)
select_model_element_5 = DSModelElementSelection()  # 1 picked in the model
curve_5 = CurveElement.Curve(curveElement=select_model_element_5)
code_block_21 = CodeBlock { [0,1/6,2/6,3/6,4/6,5/6,1]; }
pointAtParameter_4 = Curve.PointAtParameter(curve=curve_5, param=code_block_21)
code_block_22 = CodeBlock { y0=143/12; y1=142/12; y2=141/12; y3=140/12; y4=139/12; y5=138/12; y6=137/12; }
code_block_23 = CodeBlock(a=pointAtParameter_4, y=code_block_22.y0)  # same code as code_block_3
code_block_24 = CodeBlock(a=pointAtParameter_4, y=code_block_22.y1)  # same code as code_block_4
code_block_25 = CodeBlock(a=pointAtParameter_4, y=code_block_22.y2)  # same code as code_block_5
code_block_26 = CodeBlock(a=pointAtParameter_4, y=code_block_22.y3)  # same code as code_block_6
code_block_27 = CodeBlock(a=pointAtParameter_4, y=code_block_22.y4)  # same code as code_block_7
code_block_28 = CodeBlock(a=pointAtParameter_4, y=code_block_22.y5)  # same code as code_block_8
code_block_29 = CodeBlock(a=pointAtParameter_4, y=code_block_22.y6)  # same code as code_block_9
select_model_element_6 = DSModelElementSelection()  # 1 picked in the model; graph input
curve_6 = CurveElement.Curve(curveElement=select_model_element_6)
code_block_30 = CodeBlock { [0,1/6,2/6,3/6,4/6,5/6,1]; }
pointAtParameter_5 = Curve.PointAtParameter(curve=curve_6, param=code_block_30)
code_block_31 = CodeBlock(a=pointAtParameter_5, y=code_block_22.y6)  # same code as code_block_3
code_block_32 = CodeBlock(a=pointAtParameter_5, y=code_block_22.y5)  # same code as code_block_4
code_block_33 = CodeBlock(a=pointAtParameter_5, y=code_block_22.y4)  # same code as code_block_5
code_block_34 = CodeBlock(a=pointAtParameter_5, y=code_block_22.y3)  # same code as code_block_6
code_block_35 = CodeBlock(a=pointAtParameter_5, y=code_block_22.y2)  # same code as code_block_7
code_block_36 = CodeBlock(a=pointAtParameter_5, y=code_block_22.y1)  # same code as code_block_8
code_block_37 = CodeBlock(a=pointAtParameter_5, y=code_block_22.y0)  # same code as code_block_9
code_block_38 = CodeBlock(a=code_block_23.control, b=code_block_24.control, c=code_block_25.control, d=code_block_26.control, e=code_block_27.control, f=code_block_28.control, g=code_block_29.control, h=code_block_31.control, i=code_block_32.control, j=code_block_33.control, k=code_block_34.control, l=code_block_35.control, m=code_block_36.control, n=code_block_37.control) { [a,b,c,d,e,f,g,h,i,j,k,l,m,n]; }
byPoints_3 = NurbsCurve.ByPoints(points=code_block_38)
select_model_element_7 = DSModelElementSelection()  # 1 picked in the model
curve_7 = CurveElement.Curve(curveElement=select_model_element_7)
code_block_39 = CodeBlock { [0,1/6,2/6,3/6,4/6,5/6,1]; }
pointAtParameter_6 = Curve.PointAtParameter(curve=curve_7, param=code_block_39)
code_block_40 = CodeBlock(a=pointAtParameter_6)  # same code as code_block_20
byPoints_4 = NurbsCurve.ByPoints(points=code_block_40.control)
list_create = List.Create(item0=byPoints, item1=byPoints_2, item2=byPoints_3, item3=byPoints_4)
byJoinedCurves = PolyCurve.ByJoinedCurves(curves=list_create)
byPatch_2 = Surface.ByPatch(closedCurve=byJoinedCurves)
code_block_41 = CodeBlock { 0.5/12; }
boolean = BoolSelector(false)
thicken = Surface.Thicken(surface=byPatch_2, thickness=code_block_41, both_sides=boolean)
ZAxis = Vector.ZAxis()
code_block_42 = CodeBlock { 144/12; }
extrudeAsSolid = Curve.ExtrudeAsSolid(curve=curve, direction=ZAxis, distance=code_block_42)
differenceAll = Solid.DifferenceAll(solid=thicken, others=extrudeAsSolid)
code_block_43 = CodeBlock { -(4+(7/16))/12; }
offset = Curve.Offset(curve=curve, distance=code_block_43)
ZAxis_2 = Vector.ZAxis()
code_block_44 = CodeBlock { 144/12; }
extrudeAsSolid_2 = Curve.ExtrudeAsSolid(curve=offset, direction=ZAxis_2, distance=code_block_44)
offset_2 = Curve.Offset(curve=list_create)
list_create_2 = List.Create(item0=curve_2, item1=byPoints_2, item2=curve_5, item3=byPoints_4)
